# Grasshopper definition rhinoinsideTestFIle.gh (Grasshopper 1.0.7)

num2 = Slider(13, range=0..100)
num2_2 = Slider(0, range=0..100)
num1 = Slider(0, range=0..100)
xy = XYPlane(Origin=Point(0, 0, 0))
makesphere = CSharpScript(location=xy, radius=num2)  # -> out, result; inputs location: Plane, radius: Double
# ---------- makesphere: C# ----------
    Sphere sphere = new Sphere(location, radius);
    
    result = sphere;
# ---------- end makesphere ----------
addition = CSharpScript(num1=num1, num2=num2_2)  # -> out, result; inputs num1: Double, num2: Double
# ---------- addition: C# ----------
    result = num1 + num2;
# ---------- end addition ----------
resultsphere = Mesh(makesphere.result)
result = Number(addition.result)
